# Grasshopper definition lattice derniere versionv3.gh (Grasshopper 1.0.7)
# plug-ins: Kangaroo2 Components

panel = Panel("Ici aussi")
# table de connectivité + coordonnée en entrée + rayon
F = File("C:\Users\Rachd\OneDrive - Université Grenoble Alpes\Documents\GI\3A\S9\Fab\Project meta cristaux\test octet\coordonnees_motif_octettruss.csv")
F_2 = File("C:\Users\Rachd\OneDrive - Université Grenoble Alpes\Documents\GI\3A\S9\Fab\Project meta cristaux\test octet\connectivite_motif_octettruss.csv")
F_3 = File("C:\Users\Rachd\OneDrive - Université Grenoble Alpes\Documents\GI\3A\S9\Fab\Project meta cristaux\test octet\table_rayon_motif_octettruss.csv")
file = ReadFile(File=F_2, PerLineParse=True)
file_2 = ReadFile(File=F_3, PerLineParse=True)
coords = ImportCoordinates(File=F, Separator=",", XIndex=0, YIndex=1, ZIndex=2)
split = TextSplit(Text=file, Separators=",")
division = Division(A=file_2, B=Slider(1, range=0..10))
item = ListItem(List=split, Index=0, Wrap=True)  # -> Item, Item1
item_2 = ListItem(List=coords, Index=item.Item, Wrap=True)
panel_2 = Panel(coords)
item_3 = ListItem(List=coords, Index=item.Item1, Wrap=True)
ln = Line(StartPoint=item_2, EndPoint=item_3)
mp = MultiPipe(
    Curves=flatten(ln),
    NodeSize=division,
    SizePoints=coords,
    EndOffset=Slider(0.464, range=0..10),
    StrutSize=Slider(0.863, range=0..2),
    Segment=0,
    KinkAngle=0.6,
    CubeFit=Slider(1, range=0..1),
    Caps=1)  # -> flatten(Pipe)
number_slider = Slider(10, range=0..100)
# faire des répétitions à partir de courbe
pt = ConstructPoint(XCoordinate=0, YCoordinate=0, ZCoordinate=0)
number_slider_2 = Slider(3, range=0..10)
pt_2 = ConstructPoint(XCoordinate=number_slider, YCoordinate=number_slider, ZCoordinate=Slider(20, range=0..100))
box = Box2Pt(PointA=pt, PointB=pt_2, Plane=PlaneXY(0, 0, 0))
crv = Curve([<curve referenced from the Rhino model> x12])
arrbox = BoxArray(Geometry=crv, Cell=box, XCount=number_slider_2, YCount=number_slider_2, ZCount=Slider(3, range=0..10))  # -> Geometry, Transform
mp_2 = MultiPipe(
    Curves=flatten(arrbox.Geometry),
    NodeSize=Slider(1, range=0..10),
    EndOffset=Slider(4, range=0..10),
    StrutSize=1,
    Segment=0,
    KinkAngle=0.6,
    CubeFit=0,
    Caps=0)
